# Grasshopper definition assignment-01.gh (Grasshopper 1.0.8)

# Assignment-01: Bauhaus
number_slider = Slider(3, range=3..10)
number_slider_2 = Slider(3, range=3..10)
number_slider_3 = Slider(0, range=0..10)
pt = Point(Point(0, 0, 0))
expression = Expression(r=number_slider_2, Expression="r*1.41421356237")
pln = Plane(pt)
py3 = Python3Script(Basepoint=pt, corners=number_slider, h=expression, r=number_slider_2, plane=pln)  # -> out, Pyramid; inputs Basepoint: Point3d, plane: Surface
# ---------- py3: Python ----------
from cdf import create_pyramid

Pyramid = create_pyramid(point=Basepoint, number_of_corners=corners, height=h, radius=r,
                   plane=plane)
# ---------- end py3 ----------
# Setting path for Src AutoReloader: 1. Right click on Path
# 2. Choose "Select a directory"
# 3. Locate the ..\cdf1_teaching\src folder in your computer
path = FilePath("C:\Users\leopo\workspace\cdf1_teaching_Fork\src\")

# ---- group: Auto-reloads cdf module on VScode changes
autoreloader = Python3Script(src_path=path)  # -> out; inputs src_path: String
# ---------- autoreloader: Python ----------
#! python3
import sys, os, time
import scriptcontext as sc
import Rhino, System
from System.IO import FileSystemWatcher, NotifyFilters

VERSION = 1  
pkg = "cdf"

if not src_path:
    raise Exception("Connect a folder to src_path.")
path = os.path.normpath(src_path)
watch_dir = os.path.join(path, pkg)
if not os.path.isdir(watch_dir):
    raise Exception("No '{}' folder found in:\n{}".format(pkg, path))

def unload():
    for name in list(sys.modules):
        if name == pkg or name.startswith(pkg + "."):
            del sys.modules[name]

# Put this folder first in Python's search list
if path in sys.path:
    sys.path.remove(path)
sys.path.insert(0, path)

key = "cdf_watcher_" + str(ghenv.Component.InstanceGuid)
time_key = key + "_time"
version_key = key + "_version"

def stamp():
    sc.sticky[time_key] = time.strftime("%Y-%m-%d %H:%M:%S")

# Replace the old watcher if the folder changed or the script was updated
old = sc.sticky.get(key)
if old is not None and (os.path.normpath(old.Path) != watch_dir
                        or sc.sticky.get(version_key) != VERSION):
    old.Dispose()
    del sc.sticky[key]
    unload()

if key not in sc.sticky:
    comp = ghenv.Component
    last = [0.0]

    def reload_and_rerun():
        unload()
        stamp()
        doc = comp.OnPingDocument()
        if doc is None:            # reloader was deleted or the file closed
            return
        for obj in doc.Objects:
            if "Python" in obj.GetType().Name:
                obj.ExpireSolution(False)   # mark as out of date
        doc.NewSolution(False)              # recompute once

    def on_change(sender, e):
        if not e.FullPath.endswith(".py") or "__pycache__" in e.FullPath:
            return
        if time.time() - last[0] < 0.5:     # ignore the second event of a double save
            return
        last[0] = time.time()
        Rhino.RhinoApp.InvokeOnUiThread(System.Action(reload_and_rerun))

    w = FileSystemWatcher(watch_dir, "*.py")
    w.IncludeSubdirectories = True
    w.NotifyFilter = NotifyFilters.LastWrite
    w.Changed += on_change
    w.EnableRaisingEvents = True
    sc.sticky[key] = w
    sc.sticky[version_key] = VERSION
    stamp()                                  # time the watcher started

msg = "Last reloaded: {}\nWatching: {}".format(sc.sticky.get(time_key, "unknown"), watch_dir)
print(msg)
out = msg
# ---------- end autoreloader ----------
panel = Panel(autoreloader)

# ----
scale = Scale(Geometry=py3.Pyramid, Center=pt, Factor=Slider(21, range=0..100))  # -> Geometry, Transform
debrep = DeconstructBrep(Brep=scale.Geometry)  # -> Faces, Edges, Vertices
volume = Volume(Geometry=scale.Geometry)  # -> Volume, Centroid
pln_2 = Plane(debrep.Vertices)
pt_2 = Point(volume.Centroid)
deplane = DeconstructPlane(Plane=pln_2)  # -> Origin, XAxis, YAxis, ZAxis
orient = Orient(Geometry=pln_2, Source=PlaneXY(0, 0, 0), Target=pt_2)  # -> Geometry, Transform
vec2pt = Vector2Pt(PointA=deplane.Origin, PointB=pt_2, Unitize=False)  # -> Vector, Length
pl = PlaneNormal(Origin=deplane.Origin, ZAxis=vec2pt.Vector)
item = ListItem(List=debrep.Vertices, Index=0, Wrap=True)
cir = Circle(Plane=pl, Radius=Slider(21, range=0..100))
pln_3 = Plane(pl)
ln = Line(StartPoint=pt_2, EndPoint=item)
len = Length(Curve=ln)
vec2pt_2 = Vector2Pt(PointA=pt_2, PointB=deplane.Origin, Unitize=False)  # -> Vector, Length
extrude = Python3Script(brep=cir, plane=pln_3, distance=len)  # -> out, Extrusion; inputs brep: Brep, plane: Plane
# ---------- extrude: Python ----------
from cdf import extrude_brep_from_plane

Extrusion = extrude_brep_from_plane(brep, plane, distance)
# ---------- end extrude ----------
ports = Plane(pln_3)
debrep_2 = DeconstructBrep(Brep=extrude.Extrusion)  # -> Faces, Edges, Vertices
pl_2 = PlaneNormal(Origin=deplane.Origin, ZAxis=vec2pt_2.Vector)
loft_opt = LoftOptions(Closed=Toggle(False), Adjust=False, Rebuild=Slider(10, range=0..10), Refit=0, Type=0)
item_2 = ListItem(List=debrep_2.Edges, Index=Slider(2, range=0..5), Wrap=True)
offset = OffsetCurve(Curve=item_2, Distance=Slider(10, range=0..100), Corners=1)
item_3 = ListItem(List=pl, Index=Slider(3, range=0..4), Wrap=True)

# ---- group: Arms
number_slider_4 = Slider(2, range=0..20)
number_slider_5 = Slider(3, range=0..20)
number_slider_6 = Slider(1, range=0..20)
item_4 = ListItem(List=cir, Index=0, Wrap=True)
item_5 = ListItem(List=cir, Index=number_slider_6, Wrap=True)
item_6 = ListItem(List=cir, Index=number_slider_4, Wrap=True)
item_7 = ListItem(List=cir, Index=number_slider_5, Wrap=True)
item_8 = ListItem(List=flatten(offset), Index=0, Wrap=True)
item_9 = ListItem(List=flatten(offset), Index=number_slider_6, Wrap=True)
item_10 = ListItem(List=flatten(offset), Index=number_slider_4, Wrap=True)
item_11 = ListItem(List=flatten(offset), Index=number_slider_5, Wrap=True)
loft_opt_2 = LoftOptions(Closed=False, Adjust=Slider(1, range=0..10), Rebuild=0, Refit=0, Type=0)
loft_opt_3 = LoftOptions(Closed=False, Adjust=Slider(1, range=0..10), Rebuild=0, Refit=0, Type=0)
loft_opt_4 = LoftOptions(Closed=False, Adjust=Slider(1, range=0..10), Rebuild=0, Refit=0, Type=0)
loft_opt_5 = LoftOptions(Closed=False, Adjust=Slider(1, range=0..10), Rebuild=0, Refit=0, Type=0)
loft = Loft(Curves=flatten([item_9, item_5]), Options=loft_opt_2)
loft_2 = Loft(Curves=flatten([item_10, item_6]), Options=loft_opt_3)
loft_3 = Loft(Curves=flatten([item_11, item_7]), Options=loft_opt_4)
loft_4 = Loft(Curves=flatten([item_8, item_4]), Options=loft_opt_5)

# ----
sph = Sphere(Base=pt_2, Radius=Slider(32, range=0..100))
relay = Relay([loft_3, loft_2])
relay_2 = Relay([relay, loft])
cap = CapHoles(Brep=[loft_4, relay_2])

# ---- group: Curve_Control
dom = ConstructDomain(DomainStart=Slider(0, range=0..100), DomainEnd=Slider(50, range=0..100))
dom_2 = ConstructDomain(DomainStart=Slider(0, range=0..100), DomainEnd=Slider(19, range=0..100))
range = Range(Domain=Domain(0, 1), Steps=dom_2)
range_2 = Range(Domain=Domain(0, 1), Steps=dom_2)
graph = GraphMapper(
    flatten(range_2),
    x0=0,
    x1=1,
    y0=0,
    y1=1,
    container_name="Sine Summation",
    Equation0_px=[0.4929999411, 0.7054392099],
    Equation0_py=[0.4306569099, 0.9168077707],
    Equation1_px=[0.5581136942, 0.6821781397],
    Equation1_py=[0.09511327744, 0.2500231862])
graph_2 = GraphMapper(
    range,
    x0=0,
    x1=1,
    y0=0,
    y1=1,
    container_name="Bezier2",
    pt=[Point(0, 0, 0), Point(0.01120584924, 0.7632844448, 0), Point(0.258231014, 1, 0), Point(0.442579776, 0.3429945707, 0), Point(0.5851696333, -0.1651851934, 0), Point(1, 0, 0), Point(1, 0.3271983862, 0)])
graph_construction = Python3Script(t=range_2, y=graph_2, z=graph)  # -> out, curve; inputs t: list, y: list, z: list
# ---------- graph_construction: Python ----------
from cdf import create_curve



curve = create_curve(t, y, z)
# ---------- end graph_construction ----------

# ----
boolean_union = Python3Script(Brep=[cap, sph])  # -> out, Union; inputs Brep: list of Brep
# ---------- boolean_union: Python ----------
from cdf import boolean_union

Union = boolean_union(breps=Brep)
# ---------- end boolean_union ----------
attach_module = Python3Script(G=boolean_union.Union, P=ports, T=item_3, i=Slider(0, range=0..100))  # -> P2, G2; inputs G: Brep, P: list of Plane, T: Plane, i: Int32
# ---------- attach_module: Python ----------
from cdf import attach_module

G2, P2 = attach_module(G, P, T, i)
# ---------- end attach_module ----------
grow_module = Python3Script(G=boolean_union.Union, P=ports, count=Slider(100, range=0..1000), seed=Slider(0, range=0..1000))  # -> out, free_ports, shapes, color_values; inputs G: Brep, P: list of Plane
# ---------- grow_module: Python ----------
from cdf import grow_modules, color_by_generation

shapes, free_ports = grow_modules(G, P, count, seed)
color_values = color_by_generation(shapes)
# ---------- end grow_module ----------
end = EndPoints(Curve=graph_construction.curve)  # -> Start, End
gradient = Gradient(
    LowerLimit=0,
    UpperLimit=1,
    Parameter=grow_module.color_values,
    stops=[0: RGB(234, 38, 0), 0.25: RGB(234, 126, 0), 0.5: RGB(254, 244, 84), 0.75: RGB(173, 203, 249), 1: RGB(75, 107, 169)])
brep = Brep(grow_module.shapes)
scale_2 = Scale(Geometry=graph_construction.curve, Center=end.Start, Factor=Slider(1000, range=0..1000))  # -> Geometry, Transform
grow_along = Python3Script(
    G=boolean_union.Union,
    P=flatten(ports),
    C=scale_2.Geometry,
    count=Slider(60, range=1..1000),
    seed=Slider(1, range=0..100))  # -> out, shapes, free_ports, guided_count, info, color_values; inputs G: Brep, P: list of Plane, C: Curve
# ---------- grow_along: Python ----------
import importlib
import cdf.geometry_basics as gb

gb = importlib.reload(gb)

shapes, free_ports, guided_count, info = gb.grow_along_curve(
    module=G,
    ports=P,
    curve=C,
    count=count,
    seed=seed,
    return_info=True
)

color_values = gb.color_by_generation(shapes)
coverage = 100.0 * info["coverage"]
status = info["message"]
# ---------- end grow_along ----------
lng = ListLength(List=grow_along.shapes)
gradient_2 = Gradient(
    LowerLimit=0,
    UpperLimit=1,
    Parameter=grow_along.color_values,
    stops=[0: RGB(234, 38, 0), 0.25: RGB(234, 126, 0), 0.5: RGB(254, 244, 84), 0.75: RGB(173, 203, 249), 1: RGB(75, 107, 169)])
preview = CustomPreview(Geometry=brep, Material=gradient)
panel_2 = Panel(lng)
preview_2 = CustomPreview(Geometry=grow_along.shapes, Material=gradient_2)
