# Grasshopper definition geometry_basics.ghx (Grasshopper 1.0.8)

# ---- group: Example: Build a Parametric Cone
pt = Point(Point(-0.4439523925, 0.05137995213, 0))
number_slider = Slider(3, range=1..10)
number_slider_2 = Slider(2, range=1..10)

# ---- group: Auto-reloads cdf module on VScode changes
# Setting path for Src AutoReloader: 1. Right click on Path
# 2. Choose "Select a directory"
# 3. Locate the ..\cdf1_teaching\src folder in your computer
# NOTES:
# 
# - Use Python 3 Script blocks for your functions.
# - Import your functions and classes as: from cdf import my_function, My_class
# - Don't forget to add and name your INPUT and OUTPUT parameters that match your functions correctly. If you zoom in to the Python component you will see the + sign to add and - to remove them.
# - You need to attach the accurate components to your INPUT parameters: sliders for integers or floats, toggles or buttons for booleans, text for strings, Rhino geometries etc. etc.
# - If an INPUT is  a list, you need to right-click the parameter to set it as LIST access. Sometimes you need to also set the type of the INPUT by clicking TYPE HINT and selecting the correct input type.
# - If you want to hide an object, right-click component and uncheck Preview. To visualize again, check Preview.
# - If you get errors, READ THEM! They often tell what's wrong in a simple language. If not, copy-paste to CoPilot and don't be afraid to play around!
# 
# For more Grasshopper Help, go to:
# https://developer.rhino3d.com/guides/scripting/scripting-component/#script-inputs-and-outputs
path = FilePath("C:\Users\leopo\workspace\cdf1_teaching\src\")
autoreloader = Python3Script(src_path=path)  # -> out; inputs src_path: String
# ---------- autoreloader: Python ----------
#! python3
import sys, os, time
import scriptcontext as sc
import Rhino, System
from System.IO import FileSystemWatcher, NotifyFilters

VERSION = 1  
pkg = "cdf"

if not src_path:
    raise Exception("Connect a folder to src_path.")
path = os.path.normpath(src_path)
watch_dir = os.path.join(path, pkg)
if not os.path.isdir(watch_dir):
    raise Exception("No '{}' folder found in:\n{}".format(pkg, path))

def unload():
    for name in list(sys.modules):
        if name == pkg or name.startswith(pkg + "."):
            del sys.modules[name]

# Put this folder first in Python's search list
if path in sys.path:
    sys.path.remove(path)
sys.path.insert(0, path)

key = "cdf_watcher_" + str(ghenv.Component.InstanceGuid)
time_key = key + "_time"
version_key = key + "_version"

def stamp():
    sc.sticky[time_key] = time.strftime("%Y-%m-%d %H:%M:%S")

# Replace the old watcher if the folder changed or the script was updated
old = sc.sticky.get(key)
if old is not None and (os.path.normpath(old.Path) != watch_dir
                        or sc.sticky.get(version_key) != VERSION):
    old.Dispose()
    del sc.sticky[key]
    unload()

if key not in sc.sticky:
    comp = ghenv.Component
    last = [0.0]

    def reload_and_rerun():
        unload()
        stamp()
        doc = comp.OnPingDocument()
        if doc is None:            # reloader was deleted or the file closed
            return
        for obj in doc.Objects:
            if "Python" in obj.GetType().Name:
                obj.ExpireSolution(False)   # mark as out of date
        doc.NewSolution(False)              # recompute once

    def on_change(sender, e):
        if not e.FullPath.endswith(".py") or "__pycache__" in e.FullPath:
            return
        if time.time() - last[0] < 0.5:     # ignore the second event of a double save
            return
        last[0] = time.time()
        Rhino.RhinoApp.InvokeOnUiThread(System.Action(reload_and_rerun))

    w = FileSystemWatcher(watch_dir, "*.py")
    w.IncludeSubdirectories = True
    w.NotifyFilter = NotifyFilters.LastWrite
    w.Changed += on_change
    w.EnableRaisingEvents = True
    sc.sticky[key] = w
    sc.sticky[version_key] = VERSION
    stamp()                                  # time the watcher started

msg = "Last reloaded: {}\nWatching: {}".format(sc.sticky.get(time_key, "unknown"), watch_dir)
print(msg)
out = msg
# ---------- end autoreloader ----------
panel = Panel(autoreloader)

# ----
pt_2 = Point(Point(-0.4439523925, 0.05137995213, 3.562958138))

# ---- group: TODO: Build a Parametric Sphere
sphere = Python3Script(pt=pt_2, r=Slider(2, range=0..100))  # -> out, my_sphere; inputs pt: Point3d
# ---------- sphere: Python ----------
from cdf import create_sphere

my_sphere = create_sphere(center_point=pt, radius=r)
# ---------- end sphere ----------

# ---- group: TODO: Make Transformations
transformation = Python3Script(my_sphere=sphere.my_sphere, distance=Slider(7, range=1..10), count=Slider(2, range=1..10))  # -> out, my_spheres; inputs my_sphere: Brep
# ---------- transformation: Python ----------
from cdf import copy_brep_along_z

my_spheres = copy_brep_along_z(my_sphere, distance, count)
# ---------- end transformation ----------

# ---- group: TODO: Make a Boolean Difference
boolean = Python3Script(sphere=sphere.my_sphere)  # -> out, result_geometry; inputs cone: Brep, sphere: Brep
# ---------- boolean: Python ----------
from cdf import boolean_difference

result_geometry = boolean_difference(brep_a=cone, brep_b=sphere)
# ---------- end boolean ----------

# ---- group: Visualize
preview = CustomPreview(Geometry=sphere.my_sphere, Material=ColourSwatch(SwatchColor=RGB(255, 86, 88)))

preview_2 = CustomPreview(Geometry=boolean.result_geometry, Material=ColourSwatch(SwatchColor=RGB(255, 86, 255)))

preview_3 = CustomPreview(Material=ColourSwatch(SwatchColor=RGB(60, 230, 88)))

preview_4 = CustomPreview(Geometry=transformation.my_spheres, Material=ColourSwatch(SwatchColor=RGB(255, 255, 96)))

# ----
number_slider_3 = Slider(4, range=0..100)
pt_3 = Point(Point(28.21814228, 0, 100.8533228))
pt_4 = Point(Point(0, 0, 0))
py3 = Python3Script(pt=pt_3, hoehe=Slider(91.52, range=0..1000), r=Slider(25, range=0..1000))  # -> out, Cylinder_1; inputs pt: Point3d
# ---------- py3: Python ----------
from cdf import create_cylinder

Cylinder_1 = create_cylinder(base_point=pt, height=hoehe, radius=r)
# ---------- end py3 ----------
box = Python3Script(pt=pt_4, breite=Slider(46, range=0..100), tiefe=Slider(15, range=0..100), hoehe=Slider(142, range=0..1000))  # -> out, Box_1; inputs pt: Point3d
# ---------- box: Python ----------
from cdf import create_box

Box_1 = create_box(base_point=pt, width=breite, depth=tiefe, height=hoehe)
# ---------- end box ----------
Y = UnitY(Factor=number_slider_3)
Y_2 = UnitY(Factor=number_slider_3)

# ---- group: Visualize
preview_5 = CustomPreview(Geometry=py3.Cylinder_1, Material=ColourSwatch(SwatchColor=RGB(17, 0, 255)))

# ----
neg = Negative(Value=Y)
pt_5 = Point(Point(-16.04284283, 0, 17.37297238))
neg_2 = Negative(Value=Y_2)
pt_6 = Point(Point(8.6, 0, 73.3))
move = Move(Geometry=pt_5, Motion=neg)  # -> Geometry, Transform
move_2 = Move(Geometry=pt_6, Motion=neg_2)  # -> Geometry, Transform

# ---- group: Visualize
preview_6 = CustomPreview(Geometry=box.Box_1, Material=ColourSwatch(SwatchColor=RGB(17, 0, 255)))

# ----
py3_2 = Python3Script(Abgezogen=box.Box_1, Abziehen=py3.Cylinder_1)  # -> out, Abzug; inputs Abgezogen: Brep, Abziehen: Brep
# ---------- py3_2: Python ----------
from cdf import boolean_difference1

Abzug = boolean_difference1(brep_a=Abgezogen, brep_b=Abziehen)
# ---------- end py3_2 ----------
panel_2 = Panel(move.Geometry)
panel_3 = Panel(move_2.Geometry)
number_slider_4 = Slider(2, range=0..100)
box_2 = Python3Script(pt=move.Geometry, breite=Slider(60, range=0..100), tiefe=number_slider_3, hoehe=Slider(62, range=0..1000))  # -> out, Box_1; inputs pt: Point3d; same code as box
py3_3 = Python3Script(pt=move_2.Geometry, breite=Slider(28, range=0..100), tiefe=number_slider_3, hoehe=Slider(78, range=0..1000))  # -> out, Box_1; inputs pt: Point3d; same code as box
pt_7 = Point(Point(10.19754673, 0, 0))
preview_7 = CustomPreview(Geometry=py3_2.Abzug, Material=ColourSwatch(SwatchColor=RGB(17, 0, 255)))
edges = BrepEdges(Brep=box_2.Box_1)  # -> Naked, Interior, NonManifold
edges_2 = BrepEdges(Brep=py3_3.Box_1)  # -> Naked, Interior, NonManifold
Y_3 = UnitY(Factor=number_slider_4)
pt_8 = Point(Point(10.19754673, 0, 0))
debrep = DeconstructBrep(Brep=py3_2.Abzug)  # -> Faces, Edges, Vertices
neg_3 = Negative(Value=Y_3)
item = ListItem(List=edges.Interior, Index=Slider(8, range=0..12), Wrap=True)
item_2 = ListItem(List=edges_2.Interior, Index=Slider(8, range=0..12), Wrap=True)
move_3 = Move(Geometry=pt_8, Motion=neg_3)  # -> Geometry, Transform
line = Line(item)
line_2 = Line(item_2)
midpt = CurveMiddle(Curve=line_2)
midpt_2 = CurveMiddle(Curve=line)
py3_4 = Python3Script(pt=move_3.Geometry, hoehe=Slider(2, range=0..100), r=Slider(18, range=0..1000))  # -> out, Half_Cylinder; inputs pt: Point3d
# ---------- py3_4: Python ----------
from cdf import create_half_cylinder

Half_Cylinder = create_half_cylinder(base_point=pt, height=hoehe, radius=r)
# ---------- end py3_4 ----------
item_3 = ListItem(List=debrep.Faces, Index=Slider(7, range=0..20), Wrap=True)
pdecon = Deconstruct(Point=midpt)  # -> XComponent, YComponent, ZComponent
pt_9 = Point(Point(36.79008389, -31.56042182, 100.8533228))
pdecon_2 = Deconstruct(Point=midpt_2)  # -> XComponent, YComponent, ZComponent
py3_5 = Python3Script(pt=pt_7, hoehe=number_slider_4, r=Slider(20, range=0..1000))  # -> out, Half_Cylinder; inputs pt: Point3d; same code as py3_4
pt_10 = Point(Point(11.56087997, -53.50635564, 61.84496552))
panel_4 = Panel(number_slider_3)
py3_6 = Python3Script(point=pt_9, new_z=pdecon.ZComponent)  # -> out, a; inputs point: Point3d
# ---------- py3_6: Python ----------
import Rhino

if point is None or new_z is None:
    a = None
else:
    a = Rhino.Geometry.Point3d(point.X, point.Y, new_z)
# ---------- end py3_6 ----------
pln = Plane(item_3)
replace_z = Python3Script(point=pt_10, new_z=pdecon_2.ZComponent)  # -> out, a; inputs point: Point3d; same code as py3_6
extrude = Python3Script(brep=item_3, plane=pln, distance=Slider(5, range=0..100))  # -> out, Extrusion; inputs brep: Brep, plane: Plane
# ---------- extrude: Python ----------
from cdf import extrude_brep_from_plane

Extrusion = extrude_brep_from_plane(brep, plane, distance)
# ---------- end extrude ----------
py3_7 = Python3Script(pt=py3_6.a, hoehe=Slider(176.52, range=0..1000), r=Slider(25, range=0..1000))  # -> out, Cylinder_1; inputs pt: Point3d; same code as py3
py3_8 = Python3Script(pt=replace_z.a, hoehe=Slider(312.24, range=0..1000), r=Slider(25, range=0..1000))  # -> out, Cylinder_1; inputs pt: Point3d; same code as py3
preview_8 = CustomPreview(Geometry=py3_5.Half_Cylinder, Material=ColourSwatch(SwatchColor=RGB(17, 0, 255)))  # disabled
preview_9 = CustomPreview(Geometry=py3_4.Half_Cylinder, Material=ColourSwatch(SwatchColor=RGB(17, 0, 255)))
debox = DeconstructBox(Box=extrude.Extrusion)  # -> Plane, X, Y, Z
py3_9 = Python3Script(Abgezogen=box_2.Box_1, Abziehen=py3_8.Cylinder_1)  # -> out, Abzug; inputs Abgezogen: Brep, Abziehen: Brep; same code as py3_2

# ---- group: Position Bogen
neg_4 = Negative(Value=panel_4)
x = Slider(24.49, range=-100..100)
z = Slider(89.54, range=-100..100)
move_4 = Python3Script(Brep=py3_9.Abzug, x=x, y=neg_4, z=z)  # -> out, geometry_1; inputs Brep: Brep
# ---------- move_4: Python ----------
from cdf import move_geometry

geometry_1 = move_geometry(geometry=Brep, x=x, y=y, z=z)
# ---------- end move_4 ----------

# ----
py3_10 = Python3Script(Abgezogen=py3_3.Box_1, Abziehen=py3_7.Cylinder_1)  # -> out, Abzug; inputs Abgezogen: Brep, Abziehen: Brep; same code as py3_2
number_slider_5 = Slider(2, range=0..100)
item_4 = ListItem(List=debox.Plane, Index=Slider(20, range=0..20), Wrap=True)
replace_z_2 = Python3Script(point=replace_z.a, new_y=Slider(0, range=0..100))  # -> out, a; inputs point: Point3d
# ---------- replace_z_2: Python ----------
import Rhino

if point is None or new_y is None:
    a = None
else:
    a = Rhino.Geometry.Point3d(point.X, new_y, point.Z)
# ---------- end replace_z_2 ----------
preview_10 = CustomPreview(Geometry=py3_10.Abzug, Material=ColourSwatch(SwatchColor=RGB(17, 0, 255)))
scale_nu = ScaleNU(Geometry=extrude.Extrusion, Plane=item_4, ScaleX=1, ScaleY=1, ScaleZ=Slider(0.33, range=0..1))  # -> Geometry, Transform
preview_11 = CustomPreview(Geometry=move_4.geometry_1, Material=ColourSwatch(SwatchColor=RGB(17, 0, 255)))
relay = Relay([py3_4.Half_Cylinder, py3_2.Abzug])

# ---- group: Stair Count
number_slider_6 = Slider(4, range=0..100)

# ----
neg_5 = Negative(Value=number_slider_5)
number_slider_7 = Slider(3, range=0..100)
debrep_2 = DeconstructBrep(Brep=move_4.geometry_1)  # -> Faces, Edges, Vertices
debrep_3 = DeconstructBrep(Brep=scale_nu.Geometry)  # -> Faces, Edges, Vertices
replace_z_3 = Python3Script(point=replace_z.a, new_y=neg_5)  # -> out, a; inputs point: Point3d; same code as replace_z_2
item_5 = ListItem(List=debrep_2.Vertices, Index=Slider(3, range=0..100), Wrap=True)
z_2 = Slider(-44.54, range=-100..100)
x_2 = Slider(13.84, range=-100..100)
segment_cylinder = Python3Script(
    pt=replace_z_2.a,
    hoehe=number_slider_5,
    r=Slider(17.27, range=0..100),
    start=Slider(90, range=-360..360),
    ende=Slider(270, range=0..720))  # -> out, Cylinder; inputs pt: Point3d
# ---------- segment_cylinder: Python ----------
from cdf import create_segment_cylinder

Cylinder = create_segment_cylinder(center_point=pt, height=hoehe, radius=r, start_angle_degrees=start, end_angle_degrees=ende)
# ---------- end segment_cylinder ----------
scale = Python3Script(Brep=move_4.geometry_1, factor=Slider(0.62, range=0..10), base=item_5)  # -> out, Brep; inputs Brep: Brep, base: Point3d
# ---------- scale: Python ----------
from cdf import scale_geometry

Brep = scale_geometry(geometry=Brep, scale_factor=factor, origin_point=base)
# ---------- end scale ----------
relay_2 = Relay([py3_5.Half_Cylinder, relay])
item_6 = ListItem(List=debrep_3.Edges, Index=Slider(6, range=0..100), Wrap=True)
segment_cylinder_2 = Python3Script(
    pt=replace_z_3.a,
    hoehe=number_slider_5,
    r=Slider(10.34, range=0..100),
    start=Slider(-36, range=-360..360),
    ende=Slider(191, range=0..720))  # -> out, Cylinder; inputs pt: Point3d; same code as segment_cylinder
preview_12 = CustomPreview(Geometry=segment_cylinder.Cylinder, Material=ColourSwatch(SwatchColor=RGB(17, 0, 255)))
move_5 = Python3Script(Brep=scale.Brep, x=x_2, y=Slider(0, range=0..100), z=z_2)  # -> out, geometry_1; inputs Brep: Brep; same code as move_4
len = Length(Curve=item_6)
py3_11 = Python3Script(Brep=scale_nu.Geometry, Staircount=number_slider_6)  # -> out, Stairs, cutter, cut_body, tread, rise; inputs Brep: Brep
# ---------- py3_11: Python ----------
from cdf import create_stair_cut

cutter, cut_body, tread, rise = create_stair_cut(
    body=Brep,
    N=Staircount
)

Stairs = cutter
# ---------- end py3_11 ----------
preview_13 = CustomPreview(Geometry=segment_cylinder_2.Cylinder, Material=ColourSwatch(SwatchColor=RGB(17, 0, 255)))
preview_14 = CustomPreview(Geometry=py3_9.Abzug, Material=ColourSwatch(SwatchColor=RGB(17, 0, 255)))
preview_15 = CustomPreview(Geometry=move_5.geometry_1, Material=ColourSwatch(SwatchColor=RGB(17, 0, 255)))
Z = UnitZ(Factor=len)
relay_3 = Relay([py3_10.Abzug, relay_2])
preview_16 = CustomPreview(
    Geometry=py3_11.Stairs,
    Material={diffuse=RGB(221, 160, 221), emission=RGB(66, 48, 66), shine=0.5, specular=RGB(255, 255, 255), transparency=0})
relay_4 = Relay([segment_cylinder.Cylinder, segment_cylinder_2.Cylinder])
move_6 = Move(Geometry=scale_nu.Geometry, Motion=Z)  # -> Geometry, Transform
debrep_4 = DeconstructBrep(Brep=move_6.Geometry)  # -> Faces, Edges, Vertices
relay_5 = Relay([relay_4, py3_9.Abzug, move_4.geometry_1])
relay_6 = Relay([move_5.geometry_1, relay_5, relay_3])
item_7 = ListItem(List=debrep_4.Faces, Index=Slider(7, range=0..100), Wrap=True)
py3_12 = Python3Script(Brep=move_6.Geometry, Staircount=number_slider_6)  # -> out, Stairs, cutter, cut_body, tread, rise; inputs Brep: Brep; same code as py3_11
item_8 = ListItem(List=debrep_4.Edges, Index=Slider(21, range=0..100), Wrap=True)
len_2 = Length(Curve=item_8)
Y_4 = UnitY(Factor=len_2)
Z_2 = UnitZ(Factor=len)
mirror = Mirror(Geometry=py3_12.Stairs, Plane=item_7)  # -> Geometry, Transform
move_7 = Move(Geometry=py3_12.Stairs, Motion=Z_2)  # -> Geometry, Transform
move_8 = Move(Geometry=mirror.Geometry, Motion=Y_4)  # -> Geometry, Transform
preview_17 = CustomPreview(
    Geometry=move_8.Geometry,
    Material={diffuse=RGB(221, 160, 221), emission=RGB(66, 48, 66), shine=0.5, specular=RGB(255, 255, 255), transparency=0})
py3_13 = Python3Script(Brep=move_7.Geometry, Staircount=number_slider_6)  # -> out, Stairs, cutter, cut_body, tread, rise; inputs Brep: Brep; same code as py3_11
relay_7 = Relay([py3_13.Stairs, move_8.Geometry])
relay_8 = Relay([py3_11.Stairs, relay_7])
relay_9 = Relay([relay_6, relay_8])

# ---- group: Farbpalette
colour_assign = Python3Script(
    Brep=flatten(relay_9),
    palette=[ColourSwatch(SwatchColor=RGB(238, 255, 0)), ColourSwatch(SwatchColor=RGB(0, 0, 0)), ColourSwatch(SwatchColor=RGB(0, 17, 255)), ColourSwatch(SwatchColor=RGB(255, 0, 0))],
    seed=Slider(4320, range=0..10000))  # -> out, colors; inputs Brep: list, palette: list
# ---------- colour_assign: Python ----------
from cdf import assign_colors

colors= assign_colors(geometries=Brep, palette=palette, seed=seed)
# ---------- end colour_assign ----------
panel_5 = Panel(colour_assign.colors)
preview_18 = CustomPreview(Geometry=flatten(relay_9), Material=colour_assign.colors)
